# Grasshopper definition AmirInternalised.ghx (Grasshopper 1.0.8)
# plug-ins: ClayBESO

number_slider = Slider(3, range=0..3)
heightsofstructure = Number(Tree({0;0;0;0;0;0}: [0.625, 0.7072423407, 0.7488687202, 0.7293216567, 0.6582546057, 0.5707645326, 0.5100590284, 0.5061179355, 0.5608875903, 0.6473196118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], {0;0;1;0;0;0}: [0.625, 0.7072423407, 0.7488687202, 0.7293216567, 0.6582546057, 0.5707645326, 0.5100590284, 0.5061179355, 0.5608875903, 0.6473196118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], {0;0;2;0;0;0}: [0.625, 0.7072423407, 0.7488687202, 0.7293216567, 0.6582546057, 0.5707645326, 0.5100590284, 0.5061179355, 0.5608875903, 0.6473196118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], {0;0;3;0;0;0}: [0.625, 0.7072423407, 0.7488687202, 0.7293216567, 0.6582546057, 0.5707645326, 0.5100590284, 0.5061179355, 0.5608875903, 0.6473196118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], {0;0;4;0;0;0}: [0.625, 0.7072423407, 0.7488687202, 0.7293216567, 0.6582546057, 0.5707645326, 0.5100590284, 0.5061179355, 0.5608875903, 0.6473196118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], {0;0;5;0;0;0}: [0.625, 0.7072423407, 0.7488687202, 0.7293216567, 0.6582546057, 0.5707645326, 0.5100590284, 0.5061179355, 0.5608875903, 0.6473196118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]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))
pointsofstructure = Point(Tree({0;0;0;0}: [Point(8, 0, -2), Point(7.871436737, 1.428455005, -1.982142857), Point(7.489879015, 2.810998459, -1.964285714), Point(6.86759038, 4.103194166, -1.946428571), Point(6.024571966, 5.263509535, -1.928571429), Point(4.987918393, 6.254651878, -1.910714286)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], {0;0;1;0}: [Point(8, 0, -1.375), Point(7.871436737, 1.428455005, -1.274900516), Point(7.489879015, 2.810998459, -1.215416994), Point(6.86759038, 4.103194166, -1.217106915), Point(6.024571966, 5.263509535, -1.270316823), Point(4.987918393, 6.254651878, -1.339949753)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], {0;0;2;0}: [Point(8, 0, -0.75), Point(7.871436737, 1.428455005, -0.5676581757), Point(7.489879015, 2.810998459, -0.4665482738), Point(6.86759038, 4.103194166, -0.487785258), Point(6.024571966, 5.263509535, -0.6120622172), Point(4.987918393, 6.254651878, -0.7691852205)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], {0;0;3;0}: [Point(8, 0, -0.125), Point(7.871436737, 1.428455005, 0.1395841651), Point(7.489879015, 2.810998459, 0.2823204464), Point(6.86759038, 4.103194166, 0.2415363987), Point(6.024571966, 5.263509535, 0.04619238852), Point(4.987918393, 6.254651878, -0.1984206879)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], {0;0;4;0}: [Point(8, 0, 0.5), Point(7.871436737, 1.428455005, 0.8468265058), Point(7.489879015, 2.810998459, 1.031189167), Point(6.86759038, 4.103194166, 0.9708580554), Point(6.024571966, 5.263509535, 0.7044469942), Point(4.987918393, 6.254651878, 0.3723438447)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], {0;0;5;0}: [Point(8, 0, 1.125), Point(7.871436737, 1.428455005, 1.554068847), Point(7.489879015, 2.810998459, 1.780057887), Point(6.86759038, 4.103194166, 1.700179712), Point(6.024571966, 5.263509535, 1.3627016), Point(4.987918393, 6.254651878, 0.9431083773)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]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))
printer = Printer({"WASP 40100, 3 mm nozzle": 0, "WASP 40100, 2 mm nozzle": 1, "WASP 40100, 1.5 mm nozzle": 2}, selected="WASP 40100, 1.5 mm nozzle")
show = Show({"Problems": 0, "Layer height": 1, "Layer contact": 2, "Wall lean": 3, "Bead support": 4, "Layer tilt": 5, "Layer bond": 6, "While printing": 7, "Buckling shape": 8, "Wall thickness": 9}, selected="Problems")
wall = Wall({"One bead": 0, "Ideal thickness": 1}, selected="One bead")
c_script = CSharpScript(D=flatten(heightsofstructure), Levels=number_slider)  # -> out, R; inputs D: list, Order: Int32, Levels: Int32, Closed: Boolean
# ---------- c_script: C# ----------
// SmoothList - Grasshopper C# Script component (Rhino 8, also works in Rhino 7)
//
// Smooths a flat list of numbers, points or vectors by subdivision: each level inserts a new
// value between every pair of neighbours, and the order sets how the values are blended.
//
// Inputs (set access / type hint in the component):
//   D       List<object>  numbers, points or vectors, access = List, type hint = object
//   Order   int           1 = linear, 2 = quadratic, 3 = cubic (default 3)
//   Levels  int           number of subdivision rounds; each roughly doubles the count (0 = unchanged)
//   Closed  bool          treat the list as a loop (last value connects back to the first)
// Outputs:
//   R       List<object>  smoothed list, same type as the input

using System;
using System.Collections.Generic;
using Rhino;
using Rhino.Geometry;
using Grasshopper.Kernel;
using Grasshopper.Kernel.Types;

public class Script_Instance : GH_ScriptInstance
{
  private void RunScript(
		List<object> D,
		int Order,
		int Levels,
		bool Closed,
		ref object R)
  {
    Describe();
    if (D == null || D.Count == 0) { Print("No data."); return; }
    if (Order <= 0) Order = 3;
    Order = Math.Min(3, Order);
    if (Levels < 0) Levels = 0;

    // Numbers live in X of a Point3d so one code path handles every type.
    var v = new List<Point3d>();
    int kind = -1;
    for (int i = 0; i < D.Count; i++)
    {
      Point3d p;
      int k;
      if (!ToPoint(D[i], out p, out k)) { Print("Item " + i + " is not a number, point or vector."); return; }
      if (kind >= 0 && k != kind) { Print("Mixed data types in the list."); return; }
      kind = k;
      v.Add(p);
    }

    // A closed list given with a repeated end value: smooth the loop, then re-close it.
    bool repeated = Closed && v.Count > 2 && v[0].DistanceTo(v[v.Count - 1]) < 1e-12;
    if (repeated) v.RemoveAt(v.Count - 1);

    if (v.Count >= (Closed ? 3 : 2))
      for (int l = 0; l < Levels; l++)
        v = Subdivide(v, Order, Closed);

    if (repeated) v.Add(v[0]);

    var result = new List<object>(v.Count);
    foreach (Point3d p in v)
    {
      if (kind == 0) result.Add(p.X);
      else if (kind == 1) result.Add(p);
      else result.Add(new Vector3d(p));
    }
    R = result;
  }

  // One subdivision round. Masks:
  //   linear    keep a, insert (a+b)/2
  //   quadratic Chaikin: each edge a-b becomes 3/4a+1/4b, 1/4a+3/4b
  //   cubic     vertex (a+6b+c)/8, edge (a+b)/2
  // Open lists keep their end values fixed.
  static List<Point3d> Subdivide(List<Point3d> v, int order, bool closed)
  {
    int n = v.Count;
    int edges = closed ? n : n - 1;
    var r = new List<Point3d>(2 * n + 2);
    if (order == 2)
    {
      if (!closed) r.Add(v[0]);
      for (int i = 0; i < edges; i++)
      {
        Point3d a = v[i], b = v[(i + 1) % n];
        r.Add(Blend(a, 0.75, b, 0.25));
        r.Add(Blend(a, 0.25, b, 0.75));
      }
      if (!closed) r.Add(v[n - 1]);
      return r;
    }
    for (int i = 0; i < n; i++)
    {
      Point3d b = v[i];
      if (order == 3 && (closed || (i > 0 && i < n - 1)))
      {
        Point3d a = v[(i - 1 + n) % n], c = v[(i + 1) % n];
        b = new Point3d((a.X + 6 * b.X + c.X) / 8, (a.Y + 6 * b.Y + c.Y) / 8, (a.Z + 6 * b.Z + c.Z) / 8);
      }
      r.Add(b);
      if (i < edges) r.Add(Blend(v[i], 0.5, v[(i + 1) % n], 0.5));
    }
    return r;
  }

  static Point3d Blend(Point3d a, double wa, Point3d b, double wb)
  {
    return new Point3d(a.X * wa + b.X * wb, a.Y * wa + b.Y * wb, a.Z * wa + b.Z * wb);
  }

  // kind: 0 = number, 1 = point, 2 = vector
  static bool ToPoint(object o, out Point3d p, out int kind)
  {
    p = Point3d.Unset;
    kind = -1;
    IGH_Goo goo = o as IGH_Goo;
    if (goo != null) o = goo.ScriptVariable();
    if (o is Point3d) { p = (Point3d)o; kind = 1; return true; }
    if (o is Vector3d) { p = new Point3d((Vector3d)o); kind = 2; return true; }
    if (o is double || o is int || o is float)
    {
      p = new Point3d(Convert.ToDouble(o), 0, 0); kind = 0; return true;
    }
    double d;
    if (o is string && double.TryParse((string)o, out d)) { p = new Point3d(d, 0, 0); kind = 0; return true; }
    return false;
  }

  // Script components take their parameters from the editor, not from code comments,
  // so push the hover tooltips onto the params by nickname.
  static readonly Dictionary<string, string> Docs = new Dictionary<string, string>
  {
    { "D", "Flat list of numbers, points or vectors. Set access to List, type hint object." },
    { "Order", "1 = linear (keeps original values), 2 = quadratic (Chaikin), 3 = cubic B-spline. Default: 3." },
    { "Levels", "Subdivision rounds; each roughly doubles the count. Default: 0 (unconnected = no change)." },
    { "Closed", "Treat the list as a loop. A repeated end value is handled." },
    { "R", "Smoothed list, same type as the input." },
  };

  void Describe()
  {
    if (Component == null) return;
    var all = new List<IGH_Param>(Component.Params.Input);
    all.AddRange(Component.Params.Output);
    foreach (IGH_Param p in all)
    {
      string doc;
      if (Docs.TryGetValue(p.NickName, out doc)) p.Description = doc;
    }
  }
}
# ---------- end c_script ----------
c_script_2 = CSharpScript(D=flatten(pointsofstructure), Levels=number_slider)  # -> out, R; inputs D: list, Order: Int32, Levels: Int32, Closed: Boolean; same code as c_script
c_script_3 = CSharpScript(
    P=flatten(c_script_2.R),
    H=flatten(c_script.R),
    Profile=Slider(2.7, range=2..5),
    Squash=Slider(0, range=0..1),
    Noise=Slider(0.12, range=0..1))  # -> out, M, C; inputs P: list of Point3d, H: list of Double, W: Double, Res: Int32, Step: Double, Profile: Double, Squash: Double, Noise: Double, Corner: Double, Seed: Int32
# ---------- c_script_3: C# ----------
// ClayPrintMesh - Grasshopper C# Script component (Rhino 8, also works in Rhino 7)
//
// Turns an ordered clay-printing toolpath into a semi-realistic mesh of the printed object.
//
// Inputs (set access / type hint in the component):
//   P       List<Point3d>  ordered toolpath points (nozzle tip positions), item access = List
//   H       List<double>   layer height: one value, or one value per point, access = List
//   W       double         nominal bead width (default 2 x layer height)
//   Res     int            vertices around each bead section (default 16)
//   Step    double         max spacing between bead sections along the path (default W/3)
//   Profile double         section shape: 2 = ellipse, higher = flatter top/bottom contact (default 2.5)
//   Squash  double         vertical strain of the bottom layer under the weight above, 0..0.5 (e.g. 0.15)
//   Noise   double         extrusion irregularity as a fraction of width (e.g. 0.05):
//                          flow variation plus bumps and streaks on the bead sides
//   Corner  double         extra material build-up at sharp corners (e.g. 0.3)
//   Seed    int            random seed for the noise
// Outputs:
//   M       Mesh           printed object
//   C       List<Polyline> continuous beads found in the toolpath (travel moves removed)

using System;
using System.Collections.Generic;
using Rhino;
using Rhino.Geometry;
using Grasshopper.Kernel;

public class Script_Instance : GH_ScriptInstance
{
  private void RunScript(
		List<Point3d> P,
		List<double> H,
		double W,
		int Res,
		double Step,
		double Profile,
		double Squash,
		double Noise,
		double Corner,
		int Seed,
		ref object M,
		ref object C)
  {
    Describe();
    if (P == null || P.Count < 2) { Print("Need at least 2 points."); return; }
    if (H == null || H.Count == 0) { Print("Need a layer height."); return; }

    bool perPoint = H.Count == P.Count;
    double maxH = 0;
    foreach (double h in H) maxH = Math.Max(maxH, h);
    if (maxH <= 0) { Print("Layer height must be > 0."); return; }

    if (W <= 0) W = 2.0 * maxH;
    if (Res < 4) Res = 16;
    if (Step <= 0) Step = W / 3.0;
    if (Profile <= 0) Profile = 2.5;
    Profile = Math.Max(1.5, Profile);
    Squash = Math.Max(0.0, Math.Min(0.9, Squash));

    // Jumps longer than this are treated as travel moves and split the path into separate beads.
    double gap = Math.Max(3.0 * W, 3.0 * maxH);

    var beads = new List<List<Point3d>>();
    var beadH = new List<List<double>>();
    List<Point3d> cur = null;
    List<double> curH = null;
    double zMin = double.MaxValue, zMax = double.MinValue;
    for (int i = 0; i < P.Count; i++)
    {
      Point3d p = P[i];
      double h = perPoint ? H[i] : H[0];
      zMin = Math.Min(zMin, p.Z);
      zMax = Math.Max(zMax, p.Z);
      if (cur == null || p.DistanceTo(cur[cur.Count - 1]) > gap)
      {
        cur = new List<Point3d>();
        curH = new List<double>();
        beads.Add(cur);
        beadH.Add(curH);
      }
      else if (p.DistanceTo(cur[cur.Count - 1]) < 1e-6) continue;
      cur.Add(p);
      curH.Add(h);
    }

    // Superellipse section, unit half-size: x across the bead, y vertical.
    var ex = new double[Res];
    var ey = new double[Res];
    for (int k = 0; k < Res; k++)
    {
      double th = 2.0 * Math.PI * k / Res;
      ex[k] = SPow(Math.Cos(th), 2.0 / Profile);
      ey[k] = SPow(Math.Sin(th), 2.0 / Profile);
    }

    var mesh = new Mesh();
    var paths = new List<Polyline>();
    for (int b = 0; b < beads.Count; b++)
    {
      if (beads[b].Count < 2) continue;
      BuildBead(mesh, beads[b], beadH[b], W, Step, ex, ey, Profile, zMin, zMax,
        Squash, Noise, Corner, Seed + 7919 * b);
      paths.Add(new Polyline(beads[b]));
    }
    mesh.Normals.ComputeNormals();
    mesh.Compact();

    M = mesh;
    C = paths;
  }

  // Script components take their parameters from the editor, not from code comments,
  // so push the hover tooltips onto the params by nickname.
  static readonly Dictionary<string, string> Docs = new Dictionary<string, string>
  {
    { "P", "Toolpath points in print order (nozzle tip positions). Set access to List." },
    { "H", "Layer height: one value, or one value per point. Set access to List." },
    { "W", "Nominal bead width. Default: 2 x layer height." },
    { "Res", "Vertices around each bead cross-section. Default: 16." },
    { "Step", "Max spacing between bead sections along the path. Default: W/3." },
    { "Profile", "Section shape: 2 = ellipse, higher = flatter top/bottom contact. Default: 2.5." },
    { "Squash", "Vertical strain of the bottom layer under the weight above (0..0.5, e.g. 0.15). Squashed beads widen and the stack settles." },
    { "Noise", "Extrusion irregularity as a fraction of bead width (e.g. 0.05): flow variation plus bumps and streaks on the bead sides. Fine detail needs Res ~24 and Step ~W/6." },
    { "Corner", "Extra material build-up at sharp corners (e.g. 0.3)." },
    { "Seed", "Random seed for the noise." },
    { "M", "Mesh of the printed object." },
    { "C", "Continuous beads found in the toolpath (travel moves removed)." },
  };

  void Describe()
  {
    if (Component == null) return;
    var all = new List<IGH_Param>(Component.Params.Input);
    all.AddRange(Component.Params.Output);
    foreach (IGH_Param p in all)
    {
      string doc;
      if (Docs.TryGetValue(p.NickName, out doc)) p.Description = doc;
    }
  }

  // Beads overlap the layer below by this fraction of their height so they read as fused.
  const double Fuse = 0.15;

  static void BuildBead(Mesh mesh, List<Point3d> pts, List<double> hs, double W, double step,
    double[] ex, double[] ey, double profile, double zMin, double zMax,
    double squash, double noise, double corner, int seed)
  {
    // Resample so sections are at most `step` apart, keeping the original vertices (corners).
    var s = new List<Point3d>();
    var sh = new List<double>();
    var sd = new List<double>();
    s.Add(pts[0]); sh.Add(hs[0]); sd.Add(0);
    double dist = 0;
    for (int i = 1; i < pts.Count; i++)
    {
      Point3d a = pts[i - 1], b = pts[i];
      double len = a.DistanceTo(b);
      int div = Math.Max(1, (int)Math.Ceiling(len / step));
      for (int k = 1; k <= div; k++)
      {
        double t = k / (double)div;
        s.Add(a + (b - a) * t);
        sh.Add(hs[i - 1] + (hs[i] - hs[i - 1]) * t);
        sd.Add(dist + len * t);
      }
      dist += len;
    }
    int n = s.Count;
    int res = ex.Length;
    Vector3d Z = Vector3d.ZAxis;

    // Horizontal tangents; purely vertical moves borrow a neighbour's direction.
    var T = new Vector3d[n];
    var valid = new bool[n];
    for (int i = 0; i < n; i++)
    {
      Vector3d t = s[Math.Min(i + 1, n - 1)] - s[Math.Max(i - 1, 0)];
      t.Z = 0;
      valid[i] = t.Length > 1e-9;
      if (valid[i]) { t.Unitize(); T[i] = t; }
    }
    int first = Array.IndexOf(valid, true);
    Vector3d last = first >= 0 ? T[first] : Vector3d.XAxis;
    for (int i = 0; i < n; i++)
    {
      if (valid[i]) last = T[i];
      else T[i] = last;
    }

    // Turning angle at each sample, spread with a gaussian of ~half a bead width:
    // the nozzle slows at corners, so material piles up there.
    var turn = new double[n];
    for (int i = 1; i < n - 1; i++)
    {
      Vector3d a = s[i] - s[i - 1]; a.Z = 0;
      Vector3d b = s[i + 1] - s[i]; b.Z = 0;
      if (a.Length > 1e-9 && b.Length > 1e-9) turn[i] = Vector3d.VectorAngle(a, b);
    }
    var bulge = new double[n];
    if (corner > 0)
    {
      double sigma = 0.5 * W, reach = 3.0 * sigma;
      for (int i = 0; i < n; i++)
      {
        double sum = 0;
        for (int j = i; j >= 0 && sd[i] - sd[j] < reach; j--)
          sum += turn[j] / Math.PI * Gauss(sd[i] - sd[j], sigma);
        for (int j = i + 1; j < n && sd[j] - sd[i] < reach; j++)
          sum += turn[j] / Math.PI * Gauss(sd[j] - sd[i], sigma);
        bulge[i] = corner * sum;
      }
    }

    // Squash: vertical strain grows linearly with the height of material above
    // (squash at the bottom, 0 at the top). Volume is kept, so a flatter bead is wider,
    // and every bead settles by the total compression of the layers beneath it.
    double span = zMax - zMin;
    var center = new Point3d[n];
    var nrm = new Vector3d[n];
    var hw = new double[n];
    var hh = new double[n];
    for (int i = 0; i < n; i++)
    {
      double strain = 0, settle = 0;
      if (span > 1e-9 && squash > 0)
      {
        double above = zMax - s[i].Z;
        strain = squash * above / span;
        settle = squash * (span * span - above * above) / (2.0 * span);
      }
      double h = sh[i] * (1.0 - strain);
      double w = W / (1.0 - strain)
        * (1.0 + bulge[i])
        * (1.0 + 0.5 * noise * Fbm(sd[i] / (4.0 * W), seed));
      double wobble = noise * 0.2 * W * Fbm(sd[i] / (7.0 * W), seed + 101);

      nrm[i] = Vector3d.CrossProduct(Z, T[i]);
      hh[i] = 0.5 * h * (1.0 + Fuse);
      hw[i] = 0.5 * w;
      // The nozzle tip sits on top of the bead; the bead hangs below it.
      center[i] = s[i] - Z * (settle + hh[i]) + nrm[i] * wobble;
    }

    // Rings in order along the path: start cap dome, body, end cap dome.
    var tex = new SurfaceTexture(ex, ey, profile, noise * 0.6 * W, seed);
    int capN = Math.Max(2, res / 4);
    var rings = new List<int[]>();
    int startApex = mesh.Vertices.Add(center[0] - T[0] * hw[0]);
    for (int j = capN - 1; j >= 1; j--)
    {
      double phi = j / (double)capN * Math.PI / 2;
      rings.Add(Ring(mesh, center[0] - T[0] * (hw[0] * Math.Sin(phi)), nrm[0], hw[0], hh[0], Math.Cos(phi), ex, ey, tex, 0));
    }
    for (int i = 0; i < n; i++)
      rings.Add(Ring(mesh, center[i], nrm[i], hw[i], hh[i], 1.0, ex, ey, tex, sd[i] / W));
    int e = n - 1;
    for (int j = 1; j < capN; j++)
    {
      double phi = j / (double)capN * Math.PI / 2;
      rings.Add(Ring(mesh, center[e] + T[e] * (hw[e] * Math.Sin(phi)), nrm[e], hw[e], hh[e], Math.Cos(phi), ex, ey, tex, sd[e] / W));
    }
    int endApex = mesh.Vertices.Add(center[e] + T[e] * hw[e]);

    for (int k = 0; k < res; k++)
    {
      int k1 = (k + 1) % res;
      int[] r0 = rings[0], rl = rings[rings.Count - 1];
      mesh.Faces.AddFace(startApex, r0[k1], r0[k]);
      mesh.Faces.AddFace(rl[k], rl[k1], endApex);
    }
    for (int r = 0; r < rings.Count - 1; r++)
    {
      int[] a = rings[r], b = rings[r + 1];
      for (int k = 0; k < res; k++)
      {
        int k1 = (k + 1) % res;
        mesh.Faces.AddFace(a[k], a[k1], b[k1], b[k]);
      }
    }
  }

  // s = distance along the bead in bead widths, used to look up the surface texture.
  static int[] Ring(Mesh mesh, Point3d c, Vector3d n, double hw, double hh, double scale,
    double[] ex, double[] ey, SurfaceTexture tex, double s)
  {
    var idx = new int[ex.Length];
    for (int k = 0; k < ex.Length; k++)
    {
      double x = hw * scale * ex[k], y = hh * scale * ey[k];
      tex.Displace(k, s, hw, hh, scale, ref x, ref y);
      idx[k] = mesh.Vertices.Add(c + n * x + Vector3d.ZAxis * y);
    }
    return idx;
  }

  // Small surface imperfections on the exposed sides of a bead: bumps plus streaks dragged
  // along the extrusion direction. Each vertex moves along the section's outward normal;
  // the top and bottom contact faces are left flat.
  class SurfaceTexture
  {
    readonly double[] ex, ey;
    readonly double expo, amp;
    readonly int seed;

    public SurfaceTexture(double[] ex, double[] ey, double expo, double amp, int seed)
    {
      this.ex = ex; this.ey = ey; this.expo = expo; this.amp = amp; this.seed = seed;
    }

    public void Displace(int k, double s, double hw, double hh, double scale, ref double x, ref double y)
    {
      if (amp <= 0) return;
      // Outward normal of the superellipse |x/hw|^e + |y/hh|^e = 1.
      double gx = SPow(ex[k], expo - 1) / hw, gy = SPow(ey[k], expo - 1) / hh;
      double gl = Math.Sqrt(gx * gx + gy * gy);
      if (gl < 1e-12) return;
      double u = k / (double)ex.Length;
      double bumps = VNoise2(s / 0.6, u * 6, 6, seed + 211);
      double streaks = VNoise2(s / 3.0, u * 12, 12, seed + 307);
      double d = amp * scale * ex[k] * ex[k] * (0.55 * bumps + 0.45 * streaks);
      x += d * gx / gl;
      y += d * gy / gl;
    }
  }

  static double SPow(double v, double e)
  {
    return Math.Sign(v) * Math.Pow(Math.Abs(v), e);
  }

  static double Gauss(double x, double sigma)
  {
    return Math.Exp(-x * x / (2.0 * sigma * sigma));
  }

  // Smooth 1D value noise in [-1, 1].
  static double Hash(int i, int seed)
  {
    unchecked
    {
      uint h = (uint)(i * 374761393 + seed * 668265263);
      h = (h ^ (h >> 13)) * 1274126177u;
      h ^= h >> 16;
      return (h & 0xFFFFFF) / (double)0xFFFFFF * 2.0 - 1.0;
    }
  }

  static double VNoise(double x, int seed)
  {
    int i = (int)Math.Floor(x);
    double f = x - i;
    double u = f * f * (3 - 2 * f);
    return Hash(i, seed) * (1 - u) + Hash(i + 1, seed) * u;
  }

  // Smooth 2D value noise in [-1, 1], periodic in y with the given number of cells.
  static double VNoise2(double x, double y, int periodY, int seed)
  {
    int ix = (int)Math.Floor(x), iy = (int)Math.Floor(y);
    double fx = x - ix, fy = y - iy;
    double u = fx * fx * (3 - 2 * fx), v = fy * fy * (3 - 2 * fy);
    int y0 = ((iy % periodY) + periodY) % periodY, y1 = (y0 + 1) % periodY;
    double a = Hash(ix, seed + 7841 * y0), b = Hash(ix + 1, seed + 7841 * y0);
    double c = Hash(ix, seed + 7841 * y1), d = Hash(ix + 1, seed + 7841 * y1);
    return (a * (1 - u) + b * u) * (1 - v) + (c * (1 - u) + d * u) * v;
  }

  static double Fbm(double x, int seed)
  {
    return 0.65 * VNoise(x, seed) + 0.35 * VNoise(x * 2.7, seed + 17);
  }
}
# ---------- end c_script_3 ----------
check_layers = CheckLayers(Points=pointsofstructure, Heights=heightsofstructure, Printer=printer, Wall=wall, Show=show, Legend=True)  # -> Score, Issues, IssuePoints, IssueAreas, Mesh, Report, Info, Values, Print, Check
number_slider_2 = Slider(0, range=0..20)
mesh = Mesh(check_layers.Mesh)
preview = CustomPreview(Geometry=c_script_3.M, Material=ColourSwatch(SwatchColor=RGB(173, 112, 71)))
panel = Panel(check_layers.Report)
item = ListItem(List=check_layers.Issues, Index=number_slider_2, Wrap=True)
item_2 = ListItem(List=check_layers.IssuePoints, Index=number_slider_2, Wrap=True)
item_3 = ListItem(List=check_layers.IssueAreas, Index=number_slider_2, Wrap=True)
sph = Sphere(Base=item_2, Radius=1)
panel_2 = Panel(item)
preview_2 = CustomPreview(Geometry=[sph, item_3], Material=ColourSwatch(SwatchColor=RGB(178, 16, 16)))
