# Grasshopper definition ClayPrintStart.ghx (Grasshopper 1.0.8)
# plug-ins: ClayBESO

pt = ConstructPoint(XCoordinate=0, YCoordinate=0, ZCoordinate=Slider(3.2, range=0..20))
pt_2 = ConstructPoint(XCoordinate=0, YCoordinate=0, ZCoordinate=Slider(6.08, range=0..20))
ellipse = Ellipse(Plane=PlaneXY(0, 0, 0), Radius1=1, Radius2=Slider(2, range=0..10))  # -> Ellipse, Focus1, Focus2
ellipse_2 = Ellipse(Plane=pt, Radius1=Slider(6, range=0..10), Radius2=1)  # -> Ellipse, Focus1, Focus2
ellipse_3 = Ellipse(Plane=pt_2, Radius1=1, Radius2=Slider(2, range=0..10))  # -> Ellipse, Focus1, Focus2
entwine = Entwine(Branch00=ellipse.Ellipse, Branch01=ellipse_2.Ellipse, Branch02=ellipse_3.Ellipse, FlattenInputs=True)  # -> flatten(Result)
number_slider = Slider(40, range=0..100)
loft = Loft(Curves=entwine, Options={Adjust=False, Closed=False, LoftEnds=0, LoftSimp=0, LoftType=0, Rebuild=10, Refit=0.01})
scale = Scale(Geometry=loft, Center="0,0,0", Factor="10")  # -> Geometry, Transform
mesh_uv = MeshSurface(Surface=scale.Geometry, UCount=number_slider, VCount=number_slider, Overhang=True, Equalize=False)
tri = Triangulate(Mesh=mesh_uv)  # -> Mesh, Count
time = Slider(1, range=0..1)
# Clay Print: drag the vase sliders and watch the Score.
# Time plays the print back.  Fix Overhang pulls overhangs back.
printer = Printer({"WASP 40100, 3 mm nozzle": 0, "WASP 40100, 2 mm nozzle": 1, "WASP 40100, 1.5 mm nozzle": 2}, selected="WASP 40100, 3 mm nozzle")
optimise = BooleanToggle(True)
fix_overhang = BooleanToggle(False)
clay_print = ClayPrint(Shape=tri.Mesh, Printer=printer, Optimise=optimise, FixOverhang=fix_overhang, Time=time)  # -> Score, Report, Preview, Layers, FlowFactor, PrintTime, Info, Shape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
score = Panel(clay_print.Score)
report = Panel(clay_print.Report)
info = Panel(clay_print.Info)
get_help = Button()
help = Help(Open=get_help)  # -> URL, Version
release_version = Panel(help.Version)
