# Grasshopper definition TestVase.ghx (Grasshopper 1.0.8)
# plug-ins: ClayBESO

# ----
# Vase design
number_slider = Slider(6.08, range=0..20)
pt = ConstructPoint(XCoordinate=0, YCoordinate=0, ZCoordinate=Slider(3.2, range=0..20))
pt_2 = ConstructPoint(XCoordinate=0, YCoordinate=0, ZCoordinate=number_slider)
ellipse = Ellipse(Plane=PlaneXY(0, 0, 0), Radius1=1, Radius2=Slider(2, range=0..10))  # -> Ellipse, Focus1, Focus2
ellipse_2 = Ellipse(Plane=pt, Radius1=Slider(6, range=0..10), Radius2=1)  # -> Ellipse, Focus1, Focus2
ellipse_3 = Ellipse(Plane=pt_2, Radius1=1, Radius2=Slider(2, range=0..10))  # -> Ellipse, Focus1, Focus2
entwine = Entwine(Branch00=ellipse.Ellipse, Branch01=ellipse_2.Ellipse, Branch02=ellipse_3.Ellipse, FlattenInputs=True)  # -> flatten(Result)
number_slider_2 = Slider(40, range=0..100)
loft = Loft(Curves=entwine, Options={Adjust=False, Closed=False, LoftEnds=0, LoftSimp=0, LoftType=0, Rebuild=10, Refit=0.01})
scale = Scale(Geometry=loft, Center="0,0,0", Factor="10")  # -> Geometry, Transform
mesh_uv = MeshSurface(Surface=scale.Geometry, UCount=number_slider_2, VCount=number_slider_2, Overhang=True, Equalize=False)

tri = Triangulate(Mesh=mesh_uv)  # -> Mesh, Count

# ----
# Extract ave. edge length
medges = MeshEdges(Mesh=tri.Mesh)  # -> NakedEdges, InteriorEdges, NonManifoldEdges
entwine_2 = Entwine(Branch00=medges.NakedEdges, Branch01=medges.InteriorEdges, Branch02=medges.NonManifoldEdges, FlattenInputs=True)  # -> flatten(Result)
len = Length(Curve=entwine_2)
avr = Average(Input=len)
multiplication = Multiplication(A=avr, B="2.5")

show = Show({"Von Mises stress": 0, "Displacement": 1}, selected="Von Mises stress")
poisson = Panel("0.35")
young_s_modulus = Panel("1")
density = Panel("1900")
strength = Panel("0.03")
material = Material(YoungsModulus=young_s_modulus, Poisson=poisson, Density=density, Strength=strength)
mapping = Mapping({"Proportional (thicker = taller)": 3, "Constant aspect ratio": 2, "Constant bead area (fixed flow)": 0, "Linear inverse (fixed flow)": 1}, selected="Proportional (thicker = taller)")
shell = ShellModel(
    Mesh=tri.Mesh,
    Material=material,
    Thickness=5,
    FixBase=True,
    FixRotations=True,
    Tolerance=0.5,
    SelfWeight=True,
    GravityFactor=1)  # -> Model, Mesh, Supports, Info
analyse = ShellAnalysis(Model=shell.Model, Show=show, BondEfficiency=0, DeformScale=10, Legend=True, Buckling=False)  # -> Preview, Info, MaxDisplacement, VonMises, Displacements, Utilisation, Compliance, MaxStressPoint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
get_help = Button()
wall = WallPreview(Model=shell.Model)
rule = LayerRule(Mapping=mapping, MinLayerHeight=1, MaxLayerHeight=2.25, BeadArea=0, AspectRatio=0.4)

# ----
# Run BESO -
# thickness optimisation
number_slider_3 = Slider(1, range=0..1)
mode = Mode({"Thickness": 0, "Void": 1}, selected="Thickness")
beso = ShellBESO(
    Model=shell.Model,
    Run=Toggle(True),
    Reset=Button(),
    Mode=mode,
    MinThickness=3.5,
    MaxThickness=7,
    FilterRadius=0,
    LayerRule=rule,
    BondEfficiency=1,
    VolumeFraction=0,
    Playback=number_slider_3,
    MaxIterations=100,
    EvolutionRate=0.03,
    Penalty=3,
    AdmissionRatio=0.02,
    Legend=True)  # -> Design, Thickness, Preview, Info, Converged, Iteration, Compliance, Volume, Solid, Sensitivity

help = Help(Open=get_help)  # -> URL, Version
converged = Panel(beso.Converged)
release_version = Panel(help.Version)
method = Method({"Conforming": 0, "Eikonal": 1, "Force-aligned": 2}, selected="Force-aligned")
show_2 = Show({"Layer height": 0, "Layer height error": 1, "Wall thickness": 2, "Wall lean": 3}, selected="Layer height")
print = PrintLayers(
    Design=beso.Design,
    Method=method,
    Show=show_2,
    MaxDeviation=30,
    MaxOverhang=45,
    MaxTilt=30,
    Vertical=True,
    Smoothing=5,
    Tolerance=0.5,
    Seam=Vector(1, 0, 0),
    NominalArea=0,
    Legend=True)  # -> Layers, FlowFactor, Print, Preview, Info, RealisedHeight, Width, OverhangRatio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
stage = Stage({"Finished piece": -1, "Worst print stage": -2}, selected="Worst print stage")
show_3 = Show({"Interlayer utilisation": 0, "Interface angle": 1, "Von Mises stress": 2, "Displacement": 3, "Layer contact": 4}, selected="Von Mises stress")
check = PrintCheck(
    Print=print.Print,
    Strength=0,
    Show=show_3,
    Stage=stage,
    Stages=8,
    BondEfficiency=0,
    Orthotropic=True,
    StagePointLoads=False,
    DeformScale=10,
    Legend=True,
    Buckling=True)  # -> MaxUtilisation, Preview, Info, WorstStage, WorstPoint, Values, StageHeight, StageUtilisation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
